# Grasshopper definition Boxes-to-lines.gh (Grasshopper 1.0.7)
# plug-ins: Human, Pufferfish, Heteroptera, Kangaroo2 Components, Topologizer, MetaHopper, Kangaroo Components, TT Toolbox, Parakeet, CORE.Toolbox.Grasshopper, horsterCameraControl

seed = Slider(11, range=0..100)
case = Slider(3, range=0..50)
diagonals = Slider(0.43, range=0..1)
actuator = Slider(6, range=1..50)
number_slider = Slider(0, range=0..100)
geo = Geometry([<brep referenced from the Rhino model> x181])
box = DomainBox(Base=PlaneXY(15.5, 2.5, 0), X=Domain(-1.5, 1.5), Y=Domain(-1.5, 1.5), Z=Domain(0, 2))

# ---- group: x
python = GhPythonScript(y=seed)  # -> out, c
# ---------- python: Python ----------
import random as random
dims=[50,60,70,80,90,100]
a=[0]
rem=300
random.seed(y)
while rem>49:
    r= random.randint(0, len(dims)-1)
    rem =rem-dims[r]
    if rem>0 :
        a.append(dims[r])


    print rem
c=[]
b=0
for i in a:
    if i==0:
        c.append(i)
    else:
        b= b+ i
        c.append(b)
# ---------- end python ----------
shift = ShiftList(List=python.c, Shift=1, Wrap=False)
short = ShortestList(ListA=python.c, ListB=shift, TrimMode=2)  # -> ListA, ListB
dom = ConstructDomain(DomainStart=short.ListA, DomainEnd=short.ListB)

# ---- group: y
python_2 = GhPythonScript(y=seed)  # -> out, c
# ---------- python_2: Python ----------
import random as random
dims=[50,60,70,80,90,100]
a=[0]
rem=300
random.seed(1+y)
while rem>49:
    r= random.randint(0, len(dims)-1)
    rem =rem-dims[r]
    if rem>0 :
        a.append(dims[r])


    print rem
c=[]
b=0
for i in a:
    if i==0:
        c.append(i)
    else:
        b= b+ i
        c.append(b)
# ---------- end python_2 ----------
shift_2 = ShiftList(List=python_2.c, Shift=1, Wrap=False)
short_2 = ShortestList(ListA=python_2.c, ListB=shift_2, TrimMode=2)  # -> ListA, ListB
dom_2 = ConstructDomain(DomainStart=short_2.ListA, DomainEnd=short_2.ListB)

# ---- group: z
python_3 = GhPythonScript(y=seed)  # -> out, move, ext
# ---------- python_3: Python ----------
import random as random
dims=[50,60,70,80,90,100]
a=[0]

rem=200
random.seed(2+y)
while rem>49:
    r= random.randint(0, len(dims)-1)
    rem =rem-dims[r]
    if rem>0 :
        a.append(dims[r])


    print rem
move=[]

b=0
for i in a:
    if i==0:
        move.append(i)
    else:
        b= b+ i
        move.append(b)

a.remove(0)
ext= a
# ---------- end python_3 ----------
cull_i = CullIndex(List=python_3.move, Indices=-1, Wrap=True)
Z = UnitZ(Factor=cull_i)  # -> graft(UnitVector)

# ----
rectangle = Rectangle(Plane=box, XSize=Domain(0, 9), YSize=Domain(0, 9), Radius=0)  # -> Rectangle, Length
arrrec = RectangularArray(Geometry=box, Cell=rectangle.Rectangle, XCount=15, YCount=10)  # -> Geometry, Transform
volume = Volume(Geometry=geo)  # -> Volume, Centroid
brepsinc = PointInBreps(Brep=arrrec.Geometry, Point=volume.Centroid, Strict=False)  # -> Inside, Index
cset = CreateSet(List=brepsinc.Index)  # -> Set, Map
sort = SortList(Keys=cset.Set, ValuesA=cset.Set)  # -> Keys, ValuesA
item = ListItem(List=sort.ValuesA, Index=case, Wrap=True)
mindex = MemberIndex(Set=brepsinc.Index, Member=item)  # -> Index, Count
item_2 = ListItem(List=geo, Index=mindex.Index, Wrap=True)
geo_2 = Geometry(item_2)
dom_3 = ConstructDomain(DomainStart=Slider(0, range=0..100), DomainEnd=Slider(274, range=0..1000))
dom² = ConstructDomain²(DomainU=dom, DomainV=graft(dom_2))
rectangle_2 = Rectangle(Plane=PlaneXY(0, 0, 0), XSize=dom_3, YSize=dom_3, Radius=0)  # -> Rectangle, Length
srf = Surface(rectangle_2.Rectangle)
subsrf = Isotrim(Surface=srf, Domain=graft(dom²))  # -> flatten(Surface)

bbox = BoundingBox(Content=geo_2, Plane=PlaneXY(0, 0, 0), UnionBox=True)  # -> Box, Box_2
volume_2 = Volume(Geometry=arrrec.Geometry)  # -> Volume, Centroid
volume_3 = Volume(Geometry=bbox.Box)  # -> Volume, Centroid
cp = ClosestPoint(Point=volume_3.Centroid, Cloud=volume_2.Centroid)  # -> ClosestPoint, CPIndex, Distance
vec = VectorXYZ(
    XComponent=expr("-x", Slider(5, range=1..10)),
    YComponent=expr("-x", Slider(7.5, range=1..10)),
    ZComponent=Slider(3, range=1..10))  # -> Vector, Length
move = Move(Geometry=cp.ClosestPoint, Motion=vec.Vector)  # -> Geometry, Transform
setcam = SetCamera(CameraLocation=move.Geometry, TargetLocation=cp.ClosestPoint, Activate=Toggle(False))

move_2 = Move(Geometry=subsrf, Motion=graft(Z))  # -> simplify(Geometry), Transform
Z_2 = UnitZ(Factor=python_3.ext)  # -> graft(UnitVector)
extr = Extrude(Base=move_2.Geometry, Direction=graft(Z_2))  # -> flatten(Extrusion)
lng = ListLength(List=extr)
multiplication = Multiplication(A=lng, B=Slider(0.51, range=0.3..1))

debrep = DeconstructBrep(Brep=geo_2)  # -> Faces, Edges, Vertices
flatten = FlattenTree(Tree=debrep.Faces, Path="{0}")
flatten_2 = FlattenTree(Tree=debrep.Edges, Path="{0}")
flatten_3 = FlattenTree(Tree=debrep.Vertices, Path="{0}")
eval = EvaluateCurve(Curve=reparameterize(flatten_2), Parameter=0.5)  # -> Point, Tangent, Angle
area = Area(Geometry=flatten)  # -> Area, Centroid
cullpt = CullDuplicates(Points=flatten_3, Tolerance=0.1, CullMode=1)  # -> Points, Indices, Valence
cullpt_2 = CullDuplicates(Points=eval.Point, Tolerance=0.1, CullMode=1)  # -> Points, Indices, Valence
cullpt_3 = CullDuplicates(Points=area.Centroid, Tolerance=0.1, CullMode=1)  # -> Points, Indices, Valence
item_3 = ListItem(List=flatten_2, Index=cullpt_2.Indices, Wrap=True)
item_4 = ListItem(List=flatten, Index=cullpt_3.Indices, Wrap=True)

int = Integer(multiplication)

# ---- group: voxel
reduce = RandomReduce(List=extr, Reduction=int, Seed=Slider(30, range=0..100))

# ----
debrep_2 = DeconstructBrep(Brep=reduce)  # -> flatten(Faces), Edges, Vertices
area_2 = Area(Geometry=debrep_2.Faces)  # -> Area, Centroid
pdecon = Deconstruct(Point=area_2.Centroid)  # -> XComponent, YComponent, ZComponent
round = Round(Number=pdecon.ZComponent)  # -> Nearest, Floor, Ceiling
equals = Equality(FirstNumber=round.Nearest, SecondNumber=0)  # -> Equality, Inequality
cull = CullPattern(List=debrep_2.Faces, CullPattern=equals.Inequality)
jitter = Jitter(List=cull, Jitter=1, Seed=2)  # -> Values, Indices
subtraction = Subtraction(A=1, B=diagonals)
area_3 = Area(Geometry=jitter.Values)  # -> Area, Centroid
cullduppoints = RemoveDuplicatePoints(InputPoints=area_3.Centroid, Tolerance=0.001)  # -> OutputPoints, FirstPointIndexes
dup_pts = CleanDuplicatePoints(Points=area_3.Centroid, Tolerance=0.01)  # -> Points, Indices, Status
clean = CleanTree(RemoveNulls=True, RemoveInvalid=True, RemoveEmpty=True, Tree=dup_pts.Points)
cull_i_2 = CullIndex(List=jitter.Values, Indices=clean, Wrap=True)
lng_2 = ListLength(List=cull_i_2)
multiplication_2 = Multiplication(A=lng_2, B=Slider(0.2, range=0..1))
split = SplitList(List=cull_i_2, Index=multiplication_2)  # -> ListA, ListB
split_2 = SplitList(List=split.ListB, Index=multiplication_2)  # -> ListA, ListB
split_3 = SplitList(List=split_2.ListB, Index=multiplication_2)  # -> ListA, ListB
geo_3 = Geometry(split_3.ListA)

number_slider_2 = Slider(-4, range=-10..-4)
dupln = RemoveDuplicateLines(Lines=flatten(debrep_2.Edges), Tolerance=0.01)
ext = ExtendCurve(Curve=dupln, Type=0, Start=number_slider_2, End=number_slider_2)

# ---- group: diameter1
geo_4 = Geometry(split.ListA)
explode = Explode(Curve=geo_4, Recursive=True)  # -> Segments, Vertices
item_5 = ListItem(List=explode.Vertices, Index=0, Wrap=True)  # -> Item, Item1, Item2, Item3
ln = Line(StartPoint=item_5.Item1, EndPoint=item_5.Item3)
dupln_2 = RemoveDuplicateLines(Lines=flatten(ln), Tolerance=0.01)
cluster = Cluster_2(C=dupln_2)

# ---- group: diameter2
geo_5 = Geometry(split_2.ListA)
explode_2 = Explode(Curve=geo_5, Recursive=True)  # -> Segments, Vertices
item_6 = ListItem(List=explode_2.Vertices, Index=0, Wrap=True)  # -> Item, Item1, Item2, Item3
ln_2 = Line(StartPoint=item_6.Item, EndPoint=item_6.Item2)
dupln_3 = RemoveDuplicateLines(Lines=flatten(ln_2), Tolerance=0.01)
cluster_2 = Cluster_2(C=dupln_3)

# ----
explode_3 = Explode(Curve=geo_3, Recursive=True)  # -> Segments, Vertices
item_7 = ListItem(List=explode_3.Vertices, Index=0, Wrap=True)  # -> Item, Item1, Item2, Item3
ln_3 = Line(StartPoint=item_7.Item, EndPoint=item_7.Item2)
ln_4 = Line(StartPoint=item_7.Item1, EndPoint=item_7.Item3)
cullduplines = RemoveDuplicateLines(InputLines=flatten(ln_4), Tolerance=0.001)  # -> OutputLines, FirstLineIndexes
dupln_4 = RemoveDuplicateLines(Lines=flatten(ln_3), Tolerance=0.01)
dup_lines = CleanDuplicateLines(Lines=ln_4, Tolerance=0.01)  # -> Lines, Indices, Status
swatch = ColourSwatch(SwatchColor=RGB(0, 0, 0))
swatch_2 = ColourSwatch(SwatchColor=RGB(255, 255, 255))
clean_2 = CleanTree(RemoveNulls=True, RemoveInvalid=True, RemoveEmpty=True, Tree=dup_lines.Lines)
pt = ConstructPoint(XCoordinate="0.5", YCoordinate="0.5", ZCoordinate=0)
evalsrf = EvaluateSurface(Surface=reparameterize(geo_3), Point=pt)  # -> Point, Normal, UDirection, VDirection, Frame
amp = Amplitude(Vector=evalsrf.Normal, Amplitude="-2")
move_3 = Move(Geometry=flatten(clean_2), Motion=amp)  # -> Geometry, Transform

# ---- group: actuator
line = Line(flatten([dupln_2, dupln_3, move_3.Geometry]))
lng_3 = ListLength(List=line)
multiplication_3 = Multiplication(A=lng_3, B=Slider(0.51, range=0..1))
reduce_2 = RandomReduce(List=line, Reduction=multiplication_3, Seed=1)
len = Length(Curve=reduce_2)
subtraction_2 = Subtraction(A=len, B="20")
division = Division(A=subtraction_2, B=-2)
number_slider_3 = Slider(3, range=0..10)
ext_2 = ExtendCurve(Curve=reduce_2, Type=0, Start=division, End=division)
previewlw = CustomPreviewLineweights(Geometry=ext_2, Shader=ColourSwatch(SwatchColor=RGB(255, 255, 5)), Thickness=number_slider_3, Absolute=invert(False))

# ----
cluster_3 = Cluster_2(C=move_3.Geometry)
cluster_4 = Cluster_2(C=dupln_4)

# ---- group: joints
end = EndPoints(Curve=flatten([dupln, dupln_2, dupln_3, dupln_4, move_3.Geometry]))  # -> Start, End
end_2 = EndPoints(Curve=flatten([ext, cluster, cluster_2, cluster_4, cluster_3]))  # -> Start, End
ln_5 = Line(StartPoint=end.Start, EndPoint=end_2.Start)
ln_6 = Line(StartPoint=end.End, EndPoint=end_2.End)
join = JoinCurves(Curves=[ln_5, ln_6], Preserve=False)
ext_3 = ExtendCurve(Curve=flatten([ln_5, ln_6]), Type=0, Start=expr("x/2", "1.5"), End=Slider(0, range=0..100))
thicknes = Thicknes(C=ext_3, A="1.5", B="1.5")
brepoffset = OffsetBrep(Brep=thicknes, Distance="0.1", Solid=False, BothSides=False, RoundCorners=True, MergeFaces=False)
previewlw_2 = CustomPreviewLineweights(
    Geometry=brepoffset,
    Shader=ColourSwatch(SwatchColor=RGB(41, 144, 255)),
    Thickness=number_slider_3,
    Absolute=invert(False))

# ----
thicknes_2 = Thicknes(C=flatten([cluster, cluster_2, move_3.Geometry, cluster_3, cluster_4]), A="1.5", B="1.5")
thicknes_3 = Thicknes(C=flatten(ext), A="1.5", B="1.5")
previewlw_3 = CustomPreviewLineweights(
    Geometry=thicknes_2,
    Shader=ColourSwatch(SwatchColor=RGB(196, 102, 102)),
    Thickness=number_slider_3,
    Absolute=invert(False))
previewlw_4 = CustomPreviewLineweights(
    Geometry=thicknes_3,
    Shader=ColourSwatch(SwatchColor=RGB(255, 255, 255)),
    Thickness=number_slider_3,
    Absolute=invert(False))

brep = Brep([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])
swatch_3 = ColourSwatch(SwatchColor=RGB(0, 0, 0))

brep_2 = Brep([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])

# ----
# ELEVATOR
previewmat = CustomPreviewMaterials(Geometry=brep, DiffuseColor=ColourSwatch(SwatchColor=RGB(255, 255, 255)), Transparency=Slider(0, range=0..1))
toggle = GroupToggle(ToggleActive=False, ToggleVisible=True)  # disabled

debrep_3 = DeconstructBrep(Brep=brep_2)  # -> flatten(Faces), Edges, Vertices
srf_2 = Surface(flatten(debrep_3.Faces))
explode_4 = Explode(Curve=srf_2, Recursive=True)  # -> flatten(Segments), flatten(Vertices)
eval_2 = EvaluateCurve(Curve=reparameterize(explode_4.Segments), Parameter=0.5)  # -> Point, Tangent, Angle
area_4 = Area(Geometry=srf_2)  # -> Area, Centroid
cullpt_4 = CullDuplicates(Points=area_4.Centroid, Tolerance=0.1, CullMode=1)  # -> Points, Indices, Valence
cullpt_5 = CullDuplicates(Points=eval_2.Point, Tolerance=0.1, CullMode=1)  # -> Points, Indices, Valence
cullpt_6 = CullDuplicates(Points=explode_4.Vertices, Tolerance=0.1, CullMode=1)  # -> Points, Indices, Valence
item_8 = ListItem(List=srf_2, Index=cullpt_4.Indices, Wrap=True)
item_9 = ListItem(List=explode_4.Segments, Index=cullpt_5.Indices, Wrap=True)

srf_3 = Surface(item_8)
crv = Curve(item_9)
pt_2 = Point(cullpt_6.Points)
pt_3 = Point(pt_2)
lng_4 = ListLength(List=pt_3)
lng_5 = ListLength(List=pt_3)
dom_4 = ConstructDomain(DomainStart=Slider(0, range=0..1), DomainEnd=Slider(0.65, range=0..1))
lng_6 = ListLength(List=pt_3)
dom_5 = ConstructDomain(DomainStart=Slider(0.1, range=0..1), DomainEnd=Slider(0.3, range=0..1))
number_slider_4 = Slider(0.25, range=0..1)
number_slider_5 = Slider(0.25, range=0..1)
dup = DuplicateData(Data=Slider(6, range=0..10), Number=lng_5, Order=True)  # -> simplify(graft(Data))
random = Random(Range=dom_4, Number=lng_4, Seed=2)
dom_6 = ConstructDomain(DomainStart=0, DomainEnd=Slider(1.2, range=0..5))
random_2 = Random(Range=dom_5, Number=lng_6, Seed=2)
rnd_vector = RandomVector(Number=dup, Length=dom_6, seed=1631415, isflat=True)
msphere = MeshSphere(Base=pt_3, Radius=random, UCount=10, VCount=20)
msphere_2 = MeshSphere(Base=pt_3, Radius=random_2, UCount=10, VCount=20)
vlen = VectorLength(Vector=rnd_vector)
line_2 = LineSDL(Start=simplify(graft(pt_3)), Direction=rnd_vector, Length=vlen)
swatch_4 = ColourSwatch(SwatchColor=RGB(230, 0, 19))
swatch_5 = ColourSwatch(SwatchColor=RGB(0, 0, 0))
swatch_6 = ColourSwatch(SwatchColor=RGB(255, 255, 0))
swatch_7 = ColourSwatch(SwatchColor=RGB(255, 255, 255))
swatch_8 = ColourSwatch(SwatchColor=RGB(207, 207, 207))
line_3 = Line(flatten(line_2))

# ----
# NODES
preview = CustomPreview(Geometry=msphere, Material=ColourSwatch(SwatchColor=RGB(224, 224, 224)))
toggle_2 = GroupToggle(ToggleActive=True, ToggleVisible=False)  # disabled

previewlw_5 = CustomPreviewLineweights(Geometry=line_3, Shader=swatch_8, Thickness=Slider(0.11, range=0..1), Absolute=invert(False))
preview_2 = CustomPreview(Geometry=msphere_2, Material=swatch_8)

crv_2 = Curve(crv)
swatch_9 = ColourSwatch(SwatchColor=RGB(82, 82, 82))

cluster_5 = Cluster()  # -> R, R_2, R_3
cull_2 = CullPattern(List=crv_2, CullPattern=cluster_5.R)
cull_3 = CullPattern(List=crv_2, CullPattern=cluster_5.R_2)
cull_4 = CullPattern(List=crv_2, CullPattern=cluster_5.R_3)
number_slider_6 = Slider(0.1, range=0..1)
number_slider_7 = Slider(0.02, range=0..1)
number_slider_8 = Slider(0.03, range=0..1)
shader = Shader(swatch_9)
swatch_10 = ColourSwatch(SwatchColor=RGB(0, 0, 0))
swatch_11 = ColourSwatch(SwatchColor=RGB(0, 0, 0))
swatch_12 = ColourSwatch(SwatchColor=RGB(0, 0, 0))
swatch_13 = ColourSwatch(SwatchColor=RGB(0, 0, 0))

# ----
# BLACK
# ELEMENTS
toggle_3 = GroupToggle(ToggleActive=False, ToggleVisible=True)  # disabled
previewlw_6 = CustomPreviewLineweights(Geometry=cull_2, Shader=shader, Thickness=number_slider_6, Absolute=invert(False))
previewlw_7 = CustomPreviewLineweights(Geometry=cull_3, Shader=shader, Thickness=number_slider_6, Absolute=invert(False))
previewlw_8 = CustomPreviewLineweights(Geometry=cull_4, Shader=shader, Thickness=number_slider_6, Absolute=invert(False))
previewlw_9 = CustomPreviewLineweights(Geometry=crv_2, Shader=shader, Thickness=Slider(0.03, range=0..1), Absolute=invert(False))

# ----
# FIELDS
toggle_4 = GroupToggle(ToggleActive=False, ToggleVisible=True)  # disabled

number_slider_9 = Slider(0.07, range=0..1)
swatch_14 = ColourSwatch(SwatchColor=RGB(0, 0, 0))
swatch_15 = ColourSwatch(SwatchColor=RGB(135, 201, 255))
swatch_16 = ColourSwatch(SwatchColor=RGB(232, 232, 232))
swatch_17 = ColourSwatch(SwatchColor=RGB(255, 166, 173))

# ----
# SOME
# DIAGONALS
toggle_5 = GroupToggle(ToggleActive=False, ToggleVisible=True)  # disabled

number_slider_10 = Slider(0.24, range=0..1)
dom_7 = ConstructDomain(DomainStart=Slider(0, range=0..1), DomainEnd=Slider(0.3, range=0..1))
col = Colour(swatch_9)

srf_4 = Surface(item_4)
line_4 = Line(item_3)
pt_4 = Point(cullpt.Points)
lng_7 = ListLength(List=pt_4)
lng_8 = ListLength(List=line_4)
msphere_3 = MeshSphere(Base=pt_4, Radius="0.02", UCount=10, VCount=20)
lng_9 = ListLength(List=srf_4)
multiplication_4 = Multiplication(A=lng_9, B=subtraction)
reduce_3 = RandomReduce(List=srf_4, Reduction=multiplication_4, Seed=number_slider)
debrep_4 = DeconstructBrep(Brep=reduce_3)  # -> simplify(flatten(Faces)), Edges, Vertices
index = ItemIndex(List=srf_4, Item=reduce_3)
cull_i_3 = CullIndex(List=srf_4, Indices=index, Wrap=True)
explode_5 = Explode(Curve=debrep_4.Faces, Recursive=True)  # -> Segments, Vertices
area_5 = Area(Geometry=cull_i_3)  # -> Area, Centroid
cull_i_4 = CullIndex(List=explode_5.Vertices, Indices=-1, Wrap=True)  # -> simplify(List)
lng_10 = ListLength(List=debrep_4.Faces)
random_3 = Random(Range=Domain(0, 1), Number=lng_10, Seed=2)
round_2 = Round(Number=random_3)  # -> graft(Nearest), Floor, Ceiling

lng_11 = ListLength(List=reduce_3)
offset = OffsetCurve(Curve=cull_i_3, Distance=-0.025, Corners=1)  # -> simplify(Curve)
srf_5 = Surface(offset)
item_10 = ListItem(List=simplify(cull_i_4), Index=simplify(round_2.Nearest), Wrap=True)  # -> Item, Item1, Item2

ln_7 = Line(StartPoint=item_10.Item, EndPoint=item_10.Item2)  # -> flatten(Line)
jitter_2 = Jitter(List=ln_7, Jitter=1, Seed=2)  # -> Values, Indices
lng_12 = ListLength(List=jitter_2.Values)
multiplication_5 = Multiplication(A=lng_12)
split_4 = SplitList(List=jitter_2.Values, Index=actuator)  # -> ListA, ListB
eval_3 = EvaluateCurve(Curve=reparameterize(split_4.ListB), Parameter=0.5)  # -> Point, Tangent, Angle
scale = Scale(Geometry=split_4.ListB, Center=eval_3.Point, Factor=0.2)  # -> Geometry, Transform

division_2 = Division(A=actuator, B=lng_11)
multiplication_6 = Multiplication(A=division_2, B=100)
round_3 = Round(Number=multiplication_5)  # -> Nearest, Floor, Ceiling
addition = Addition(A=cp.CPIndex, B=1)
multiplication_7 = Multiplication(A=diagonals, B=100)
round_4 = Round(Number=multiplication_6)  # -> Nearest, Floor, Ceiling
concat = Concatenate(FragmentA="Number of Actuator : ", FragmentB=actuator)
concat_2 = Concatenate(FragmentA="Dia to Act proportion : ", FragmentB=round_4.Nearest, FragmentC="%")
concat_3 = Concatenate(FragmentA="case number : ", FragmentB=addition)
concat_4 = Concatenate(FragmentA="Number of nodes : ", FragmentB=lng_7)
concat_5 = Concatenate(FragmentA="Seed : ", FragmentB=number_slider)
concat_6 = Concatenate(FragmentA="Diagonals : ", FragmentB=multiplication_7, FragmentC="%")
concat_7 = Concatenate(FragmentA="Number of Diagonals : ", FragmentB=lng_11)
concat_8 = Concatenate(FragmentA="Number of lines : ", FragmentB=lng_8)
merge = Merge(
    Data1=flatten(concat_3),
    Data2=flatten(concat_8),
    Data3=flatten(concat_7),
    Data4=flatten(concat_6),
    Data5=flatten(concat),
    Data6=flatten(concat_2),
    Data8=flatten(concat_4),
    Data9=flatten(concat_5))  # -> flatten(Result)
lng_13 = ListLength(List=merge)
series = Series(Start=200, Step=40, Count=lng_13)
concat_9 = Concatenate(FragmentA="200,", FragmentB=series)
texttoscreen = RenderTextToScreen(Text=merge, Location=concat_9, Size=20, Color=RGB(0, 0, 0), m_scWithvp=False)

previewlw_10 = CustomPreviewLineweights(Geometry=split_4.ListA, Shader=ColourSwatch(SwatchColor=RGB(255, 255, 0)), Thickness="6", Absolute=False)
previewmat_2 = CustomPreviewMaterials(Geometry=msphere_3, DiffuseColor=swatch, Transparency=0)
previewlw_11 = CustomPreviewLineweights(Geometry=split_4.ListB, Shader=ColourSwatch(SwatchColor=RGB(230, 0, 19)), Thickness="4", Absolute=False)
previewmat_3 = CustomPreviewMaterials(Geometry=srf_5, DiffuseColor=ColourSwatch(SwatchColor=RGB(100, 100, 100)), Transparency="0.2")
previewlw_12 = CustomPreviewLineweights(Geometry=line_4, Shader=swatch, Thickness="4", Absolute=False)
previewlw_13 = CustomPreviewLineweights(Geometry=scale.Geometry, Shader=ColourSwatch(SwatchColor=RGB(0, 0, 255)), Thickness="10", Absolute=False)

evalsrf_2 = EvaluateSurface(Surface=reparameterize(srf_3), Point="0.5, 0.5")  # -> Point, Normal, UDirection, VDirection, Frame
pl = PlaneNormal(Origin=evalsrf_2.Point, ZAxis=evalsrf_2.Normal)
offcrv = OffsetCurve(Curve=srf_3, Plane=pl, Distance=Slider(-0.3, range=-0.4..0.8), BothSides=invert(False), Kinks=0, CapType=1)
area_6 = Area(Geometry=offcrv)  # -> Area, Centroid
sort_2 = SortList(Keys=area_6.Area, ValuesA=offcrv)  # -> simplify(Keys), ValuesA
item_11 = ListItem(List=sort_2.ValuesA, Index=0, Wrap=True)  # -> flatten(Item)

boundary = BoundarySurfaces(Edges=item_11)  # -> flatten(Surfaces)
srf_6 = Surface(boundary)

area_7 = Area(Geometry=srf_6)  # -> Area, Centroid
pdecon_2 = Deconstruct(Point=area_7.Centroid)  # -> XComponent, YComponent, ZComponent
round_5 = Round(Number=pdecon_2.ZComponent)  # -> Nearest, Floor, Ceiling
equals_2 = Equality(FirstNumber=round_5.Nearest, SecondNumber=0)  # -> Equality, Inequality
cull_5 = CullPattern(List=srf_6, CullPattern=equals_2.Inequality)
jitter_3 = Jitter(List=cull_5, Jitter=1, Seed=2)  # -> Values, Indices

srf_7 = Surface(jitter_3.Values)
lng_14 = ListLength(List=srf_7)
multiplication_8 = Multiplication(A=lng_14, B=Slider(0.1, range=0..1))
split_5 = SplitList(List=srf_7, Index=multiplication_8)  # -> ListA, ListB
split_6 = SplitList(List=split_5.ListB, Index=multiplication_8)  # -> ListA, ListB
split_7 = SplitList(List=split_6.ListB, Index=multiplication_8)  # -> ListA, ListB
geo_6 = Geometry(split_6.ListA)
geo_7 = Geometry(split_5.ListA)
geo_8 = Geometry(split_7.ListA)
geo_9 = Geometry(split_7.ListB)
explode_6 = Explode(Curve=geo_7, Recursive=True)  # -> Segments, Vertices
explode_7 = Explode(Curve=geo_6, Recursive=True)  # -> Segments, Vertices
explode_8 = Explode(Curve=geo_8, Recursive=True)  # -> Segments, Vertices
item_12 = ListItem(List=explode_6.Vertices, Index=0, Wrap=True)  # -> Item, Item1, Item2, Item3
item_13 = ListItem(List=explode_8.Vertices, Index=0, Wrap=True)  # -> Item, Item1, Item2, Item3
item_14 = ListItem(List=explode_7.Vertices, Index=0, Wrap=True)  # -> Item, Item1, Item2, Item3
ln_8 = Line(StartPoint=item_12.Item1, EndPoint=item_12.Item3)
ln_9 = Line(StartPoint=item_14.Item, EndPoint=item_14.Item2)
ln_10 = Line(StartPoint=item_13.Item1, EndPoint=item_13.Item3)
ln_11 = Line(StartPoint=item_13.Item, EndPoint=item_13.Item2)

toggle_6 = GroupToggle(ToggleActive=False, ToggleVisible=True)  # disabled
previewlw_14 = CustomPreviewLineweights(Geometry=ln_8, Shader=swatch_9, Thickness=number_slider_9, Absolute=invert(False))
previewlw_15 = CustomPreviewLineweights(Geometry=ln_9, Shader=swatch_9, Thickness=number_slider_9, Absolute=invert(False))
previewlw_16 = CustomPreviewLineweights(Geometry=ln_11, Shader=swatch_9, Thickness=number_slider_9, Absolute=invert(False))

previewmat_4 = CustomPreviewMaterials(Geometry=geo_8, DiffuseColor=swatch_16, Transparency=Slider(0.66, range=0..1))
previewmat_5 = CustomPreviewMaterials(Geometry=[geo_7, geo_6], DiffuseColor=swatch_16, Transparency=Slider(0.88, range=0..1))

crv_3 = Curve(flatten([ln_8, ln_9, ln_11, ln_10]))

crv_4 = Curve(flatten([crv_2, ln_10, ln_11, ln_9, ln_8]))
eval_4 = EvaluateCurve(Curve=reparameterize(crv_4), Parameter=0.5)  # -> Point, Tangent, Angle
pdecon_3 = Deconstruct(Point=eval_4.Point)  # -> XComponent, YComponent, ZComponent
crv_5 = Curve(crv_3)
srf_8 = Surface(srf_6)
line_5 = Line(crv_3)
smaller = SmallerThan(FirstNumber=pdecon_3.ZComponent, SecondNumber=0.1)  # -> SmallerThan, OrEqualTo
lng_15 = ListLength(List=crv_3)
eval_5 = EvaluateCurve(Curve=reparameterize(crv_5), Parameter=0.5)  # -> Point, Tangent, Angle
len_2 = Length(Curve=crv_5)

# ---- group: actuators
line_6 = Line(flatten([ln_8, ln_9, ln_11, ln_10]))
lng_16 = ListLength(List=line_6)
multiplication_9 = Multiplication(A=lng_16, B=Slider(0.37, range=0..1))
reduce_4 = RandomReduce(List=line_6, Reduction=multiplication_9, Seed=1)
len_3 = Length(Curve=reduce_4)
subtraction_3 = Subtraction(A=len_3, B=1.5)
division_3 = Division(A=subtraction_3, B=-2)
ext_4 = ExtendCurve(Curve=reduce_4, Type=0, Start=division_3, End=division_3)
swatch_18 = ColourSwatch(SwatchColor=RGB(255, 255, 255))
swatch_19 = ColourSwatch(SwatchColor=RGB(250, 250, 5))
previewlw_17 = CustomPreviewLineweights(
    Geometry=ext_4,
    Shader=ColourSwatch(SwatchColor=RGB(166, 0, 14)),
    Thickness=Slider(0.26, range=0..1),
    Absolute=invert(False))

# ----
area_8 = Area(Geometry=srf_8)  # -> Area, Centroid
lng_17 = ListLength(List=line_5)  # -> expr("x/2", Length)
jitter_4 = Jitter(List=line_5, Jitter=1, Seed=2)  # -> Values, Indices
multiplication_10 = Multiplication(A=lng_15, B=0.6)
cull_6 = CullPattern(List=crv_4, CullPattern=invert(smaller.SmallerThan))  # -> flatten(List)
reduce_5 = RandomReduce(List=crv_3, Reduction=multiplication_10, Seed=1)

# ----
# SMOOTH PIPE MESH
toggle_7 = GroupToggle(ToggleActive=True, ToggleVisible=False)  # disabled
crv_6 = Curve(cull_6)

split_8 = SplitList(List=jitter_4.Values, Index=lng_17)  # -> ListA, ListB
lng_18 = ListLength(List=split_8.ListB)  # -> expr("x/2", Length)
yz = YZPlane(Origin=eval_5.Point)
split_9 = SplitList(List=reduce_5, Index=Slider(50, range=0..100))  # -> ListA, ListB
lng_19 = ListLength(List=split_8.ListA)
split_10 = SplitList(List=split_8.ListB, Index=lng_18)  # -> ListA, ListB
lng_20 = ListLength(List=split_8.ListA)  # -> expr("x/1.2", Length)
random_4 = Random(Range=dom_7, Number=lng_19, Seed=2)
split_11 = SplitList(List=split_8.ListA, Index=lng_20)  # -> ListA, ListB
explode_9 = Explode(Curve=crv_6, Recursive=True)  # -> flatten(Segments), Vertices

# ----
# COLORED
# ELEMENTS
toggle_8 = GroupToggle(ToggleActive=False, ToggleVisible=True)  # disabled
previewlw_18 = CustomPreviewLineweights(
    Geometry=split_11.ListB,
    Shader=ColourSwatch(SwatchColor=RGB(255, 255, 0)),
    Thickness=Slider(0.12, range=0..1),
    Absolute=invert(False))
previewlw_19 = CustomPreviewLineweights(
    Geometry=split_11.ListA,
    Shader=ColourSwatch(SwatchColor=RGB(84, 84, 84)),
    Thickness=Slider(0.1, range=0..0.1),
    Absolute=invert(False))
previewlw_20 = CustomPreviewLineweights(Geometry=split_10.ListA, Shader=ColourSwatch(SwatchColor=RGB(255, 0, 21)), Thickness=random_4, Absolute=invert(False))
previewlw_21 = CustomPreviewLineweights(Geometry=split_10.ListB, Shader=ColourSwatch(SwatchColor=RGB(0, 86, 214)), Thickness=random_4, Absolute=invert(False))

previewlw_22 = CustomPreviewLineweights(
    Geometry=split_9.ListA,
    Shader=ColourSwatch(SwatchColor=RGB(201, 0, 17)),
    Thickness=number_slider_10,
    Absolute=invert(False))
previewlw_23 = CustomPreviewLineweights(
    Geometry=split_9.ListB,
    Shader=ColourSwatch(SwatchColor=RGB(0, 86, 214)),
    Thickness=number_slider_10,
    Absolute=invert(False))

yz_2 = YZPlane(Origin=area_8.Centroid)

# ----
# TEXT
toggle_9 = GroupToggle(ToggleActive=False, ToggleVisible=True)  # disabled
tag = TextTag3D(Location=yz_2, Text=area_8.Area, Size=Slider(0.3, range=0..0.5), Colour=col, Justification=5)
tag_2 = TextTag3D(
    Location=yz,
    Text=len_2,
    Size=Slider(0.3, range=0..0.5),
    Colour=ColourSwatch(SwatchColor=RGB(102, 0, 8)),
    Justification=7)

topo = Topologizer(LinesInput=explode_9.Segments, Tolerance=0.01)  # -> L, P, S, E, N, I, O, G
mp = MultiPipe(
    Curves=topo.L,
    NodeSize=Slider(0.1, range=0.1..3),
    EndOffset=Slider(0.5, range=0..17),
    StrutSize=Slider(0.8, range=0.1..3),
    Segment=Slider(1, range=0.5..10),
    KinkAngle=0.6,
    CubeFit=0)
preview_3 = CustomPreview(
    Geometry=mp,
    Material={diffuse=RGB(230, 230, 230), emission=RGB(0, 0, 0), shine=0, specular=RGB(255, 255, 255), transparency=0})

# ==== cluster Cluster
toggle = BooleanToggle(True)
toggle_2 = BooleanToggle(False)
merge = Merge(Data1=toggle, Data2=toggle_2, Data3=toggle_2)
merge_2 = Merge(Data1=toggle_2, Data2=toggle, Data3=toggle_2)
merge_3 = Merge(Data1=toggle_2, Data2=toggle_2, Data3=toggle)
R = ClusterOutput(merge)
R_2 = ClusterOutput(merge_2)
R_3 = ClusterOutput(merge_3)
panel = Panel(merge)

# ==== cluster Cluster_2
number_slider = Slider(-0.39, range=-1..0)
number_slider_2 = Slider(-5, range=-10..-4)
C = ClusterInput()
ext = ExtendCurve(Curve=C, Type=0, Start=number_slider_2, End=number_slider_2)
C_2 = ClusterOutput(ext)

# ==== cluster Thicknes
C = ClusterInput()
A = ClusterInput()
B = ClusterInput()
eval = EvaluateCurve(Curve=reparameterize(C), Parameter=0)  # -> Point, Tangent, Angle
dom = ConstructDomain(DomainStart=expr("x/2", A), DomainEnd=expr("x/-2", B))
pl = PlaneNormal(Origin=eval.Point, ZAxis=eval.Tangent)
rectangle = Rectangle(Plane=pl, XSize=dom, YSize=dom, Radius=0)  # -> Rectangle, Length
extrcrv = ExtrudeAlong(Base=rectangle.Rectangle, Curve=C)
E = ClusterOutput(extrcrv)
